# Grasshopper definition combinatory_facade_6.gh (Grasshopper 1.0.7)

unit_y = UnitY(Factor=1)
xz_plane = XZPlane(Origin=Point(0, 0, 0))
rectangle = Rectangle(Plane=xz_plane, XSize="3", YSize="3", Radius=0)  # -> Rectangle, Length
number_slider = Slider(0.1, range=0..0.1)
populate_2d = Populate2D(Region=rectangle.Rectangle, Count=Slider(16, range=0..100), Seed=1)
offset_curve = OffsetCurve(Curve=rectangle.Rectangle, Distance=Slider(0.3, range=0..1), Corners=1)
deconstruct_brep = DeconstructBrep(Brep=offset_curve)  # -> Faces, Edges, Vertices
divide_curve = DivideCurve(Curve=deconstruct_brep.Edges, Count=Slider(5, range=0..100), Kinks=False)  # -> Points, Tangents, Parameters
ghpython_script = GhPythonScript()  # -> out, a; inputs x: list of Brep
# ---------- ghpython_script: Python ----------
import rhinoscriptsyntax as rs
import ghpythonlib.components as gh
import random as rd

l=gh.ListLength(x)
print(l)

li = [y for y in range(l)]
print(l)

rand = rd.sample(li,int(l/1.1))
print(rand)
# ---------- end ghpython_script ----------
insert_items = InsertItems(List=populate_2d, Item=divide_curve.Points, Indices=Slider(0, range=0..100), Wrap=True)
scale = Scale(Center=Point(0, 0, 0), Factor=0.5)  # -> Geometry, Transform
voronoi = Voronoi(Points=flatten(insert_items), Boundary=offset_curve, BruteForceOverride=False)
surface = Surface(voronoi)
extrude = Extrude(Base=surface, Direction=unit_y)
area = Area(Geometry=extrude)  # -> Area, Centroid
cluster = Cluster_3(geometry=extrude, center=area.Centroid, factor=Slider(0.54, range=0..1))
cluster_2 = Cluster_3(geometry=extrude, center=area.Centroid, factor=Slider(0.46, range=0..1))
cluster_3 = Cluster_3(geometry=extrude, center=area.Centroid, factor=Slider(0.7, range=0..1))
cluster_4 = Cluster_3(geometry=extrude, center=area.Centroid, factor=Slider(0.9, range=0..1))
cluster_5 = Cluster_2(content=cluster_4, geometry=cluster_4)
cluster_6 = Cluster_2(content=cluster_2, geometry=cluster_2)
cluster_7 = Cluster_2(content=cluster_3, geometry=cluster_3)
cluster_8 = Cluster(content=cluster, geometry=cluster)

# ----
# Parameters
option_sul = Slider(62, range=0..100)
surface_2 = Surface(cluster_8)
surface_3 = Surface(cluster_6)
surface_4 = Surface(cluster_7)
surface_5 = Surface(cluster_5)
n = Slider(3, range=0..10)
m = Slider(6, range=0..10)
option_norte = Slider(64, range=0..100)
seed = Slider(7, range=0..10)

# ----
# vectors
module = Slider(3, range=0..10)  # disabled
series = Series(Start=0, Step=module, Count=n)  # disabled
series_2 = Series(Start=0, Step=module, Count=m)  # disabled
unit_x = UnitX(Factor=series_2)  # disabled
unit_z = UnitZ(Factor=series)  # disabled
move = Move(Geometry=graft(unit_x), Motion=unit_z)  # -> flatten(Geometry), Transform; disabled

panel = Panel(cluster)  # disabled

# ----
# Move to origem
ghpython_script_2 = GhPythonScript(A=surface_2, B=surface_3, C=surface_4, D=surface_5)  # -> out, a, b, c, d; inputs A: list of Brep, B: list of Brep, C: list of Brep, D: list of Brep; disabled
# ---------- ghpython_script_2: Python ----------
import rhinoscriptsyntax as rs
import ghpythonlib.components as gh
import ghpythonlib.treehelpers as gt
import Rhino as r
import rhinoscriptsyntax as rs

def move_to_origem(obj):
    box = rs.BoundingBox(obj)
    bbox =  r.Geometry.Box(r.Geometry.Plane.WorldZX,box)   
    point = gh.DeconstructBrep(bbox)[2][0]   
    vector = gh.Vector2Pt(point, gh.ConstructPoint(0,0,0), False)
    moved_objs = []
    for i in obj:
        moved_obj,_ = gh.Move(i,vector)
        moved_objs.append(moved_obj)        
    return moved_objs
    
a,b,c,d = (move_to_origem(x) for x in [A,B,C,D])
# ---------- end ghpython_script_2 ----------

panel_2 = Panel(voronoi)
curve = Curve(voronoi)

# ----
# Opacity of surfaces
ghpython_script_3 = GhPythonScript(A=ghpython_script_2.a, B=ghpython_script_2.b, C=ghpython_script_2.c, D=ghpython_script_2.d)  # -> out, opa_A, opa_B, opa_C, opa_D, opa; inputs A: list of Brep, B: list of Brep, C: list of Brep, D: list of Brep; disabled
# ---------- ghpython_script_3: Python ----------
__author__ = "joaot"
__version__ = "2022.04.20"

import rhinoscriptsyntax as rs
import ghpythonlib.components as gh
import Rhino.Geometry as rg

def porcentagem(surface):    
    area,_ = gh.Area(surface)     
    area_t,_  =  gh.MassAddition(area)    
    num = round(((area_t/9)*100),2)
    return num


opa_A, opa_B = porcentagem(A),porcentagem(B)
opa_C, opa_D = porcentagem(C),porcentagem(D)
opa = [opa_A, opa_B, opa_C, opa_D]
# ---------- end ghpython_script_3 ----------
panel_3 = Panel(ghpython_script_3.opa_D)  # disabled
panel_4 = Panel(ghpython_script_3.opa_A)  # disabled
panel_5 = Panel(ghpython_script_3.opa_B)  # disabled
panel_6 = Panel(ghpython_script_3.opa_C)  # disabled

# ----
# Letters of  facades
ghpython_script_4 = GhPythonScript(m=m, n=n, opa=ghpython_script_3.opa, seed=seed, option_sul=option_sul, option_norte=option_norte)  # -> out, area, flatten(selected_sul), flatten(selected_norte); inputs m: Int32, n: Int32, opa: list, option_sul: Int32, option_norte: Int32; disabled
# ---------- ghpython_script_4: Python ----------
import rhinoscriptsyntax as rs
import ghpythonlib.components as gh
import ghpythonlib.treehelpers as gt
import Rhino.Geometry as rg
import random as r

n_matriz = n*m
r_letras = []
area_total = 0

opa_sul = 30
opa_norte = 60
letras = ["A","B","C","D"]

def find_form(trys):
    norte = []
    sul = []
    for x in range(trys):
        r_letras = []
        area_total = 0
        #randomic phrase
        for i in range(n_matriz):
            a = r.choice(letras)
            r_letras.append(a)
            
        #Area calculation
        for j in r_letras:
            index = letras.index(j)        
            area_total = area_total + opa[index]
            
        #select module
        media = area_total/n_matriz    
        if media<opa_sul:
            sul.append(r_letras)
            
        elif media> opa_norte:
            norte.append(r_letras)            

    """
    if  len(norte)<5 or len(sul)<5:
        find_form(trys)"""
    return norte, sul

def index_wrap(option, list):
    number  = len(list)
    if option > number:
        number = option % number 
        print(number)
    else:
       number  = option
    return number
norte, sul = find_form(5000)
selected_norte = norte[index_wrap(option_norte, norte)]
selected_sul = sul[index_wrap(option_sul, sul)]


print("sul: ",len(sul))
print("norte: ",len(norte))
# ---------- end ghpython_script_4 ----------
panel_7 = Panel(ghpython_script_4.selected_sul)  # disabled
panel_8 = Panel(ghpython_script_4.selected_norte)  # disabled

# ----
# matrix
ghpython_script_5 = GhPythonScript(
    seed=seed,
    phrase_sul=ghpython_script_4.selected_sul,
    phrase_norte=ghpython_script_4.selected_norte,
    A=ghpython_script_2.a,
    B=ghpython_script_2.b,
    C=ghpython_script_2.c,
    D=ghpython_script_2.d,
    vec=move.Geometry,
    x=n)  # -> out, facade_sul, facade_norte; inputs seed: Int32, phrase_sul: list, phrase_norte: list, A: Brep, B: Brep, C: Brep, D: Brep, vec: list of Vector3d; disabled
# ---------- ghpython_script_5: Python ----------
import rhinoscriptsyntax as rs
import ghpythonlib.components as gh
import ghpythonlib.treehelpers as gt

def order_phrase (seed,letters):
    random_phrase = list(gh.Jitter(letters,1,seed))
    return random_phrase[0]
#phrase = order_phrase(seed,letters)


def geometry(A,B,C,D,phrase,vec):
    list_breps = []
    for i in phrase: 
        #print(i)
        if i =="A":
            item = A
        elif i =="B":
            item = B
        elif i =="C":
            item = C
        else:
            item = D
            
        list_breps.append(item)
       
    geo,_ = gh.Move(list_breps,vec)
    
    return geo


facade_sul = geometry(A,B,C,D,phrase_sul,vec)
facade_norte = geometry(A,B,C,D,phrase_norte,vec)
facade_norte,_ =  gh.Move(facade_norte,gh.UnitY(3*x))
# ---------- end ghpython_script_5 ----------
geometry = Geometry(ghpython_script_5.facade_sul)  # disabled
geometry_2 = Geometry(ghpython_script_5.facade_norte)  # disabled
panel_9 = Panel(geometry)  # disabled

# ==== cluster Cluster
geometry = ClusterInput()
content = ClusterInput()
bounding_box = BoundingBox(Content=content, Plane=PlaneXY(0, 0, 0), UnionBox=True)  # -> Box, Box_2
deconstruct_brep = DeconstructBrep(Brep=bounding_box.Box)  # -> Faces, Edges, Vertices
area = Area(Geometry=bounding_box.Box)  # -> Area, Centroid
list_item = ListItem(List=deconstruct_brep.Edges, Index=0, Wrap=True)
length = Length(Curve=list_item)
division = Division(A=Slider(3, range=0..10), B=length)
scale = Scale(Geometry=geometry, Center=area.Centroid, Factor=division)  # -> Geometry, Transform
geometry_2 = ClusterOutput(scale.Geometry)

# ==== cluster Cluster_2
content = ClusterInput()
bounding_box = BoundingBox(Content=content, Plane=PlaneXY(0, 0, 0), UnionBox=True)  # -> Box, Box_2
deconstruct_brep = DeconstructBrep(Brep=bounding_box.Box)  # -> Faces, Edges, Vertices
area = Area(Geometry=bounding_box.Box)  # -> Area, Centroid
geometry = ClusterInput()
list_item = ListItem(List=deconstruct_brep.Edges, Index=0, Wrap=True)
length = Length(Curve=list_item)
division = Division(A=Slider(3, range=0..10), B=length)
scale = Scale(Geometry=geometry, Center=area.Centroid, Factor=division)  # -> Geometry, Transform
geometry_2 = ClusterOutput(scale.Geometry)

# ==== cluster Cluster_3
geometry = ClusterInput()
center = ClusterInput()
factor = ClusterInput()
scale = Scale(Geometry=geometry, Center=center, Factor=factor)  # -> Geometry, Transform
deconstruct_brep = DeconstructBrep(Brep=scale.Geometry)  # -> flatten(Faces), Edges, Vertices
faces = ClusterOutput(deconstruct_brep.Faces)
