# Grasshopper definition definition.gh (Grasshopper 1.0.7)

# ----
# Parameters
option_sul = Slider(14, range=0..100)
surface = Surface([<surface referenced from the Rhino model> x5])
surface_2 = Surface([<surface referenced from the Rhino model> x7])
surface_3 = Surface([<surface referenced from the Rhino model> x10])
surface_4 = Surface([<surface referenced from the Rhino model> x10])
n = Slider(3, range=0..10)
m = Slider(6, range=0..10)
option_norte = Slider(92, range=0..100)
seed = Slider(8, range=0..10)

# ----
# Move to origem
ghpython_script = GhPythonScript(A=surface, B=surface_2, C=surface_3, D=surface_4)  # -> out, a, b, c, d; inputs A: list of Brep, B: list of Brep, C: list of Brep, D: list of Brep
# ---------- ghpython_script: Python ----------
import rhinoscriptsyntax as rs
import ghpythonlib.components as gh
import ghpythonlib.treehelpers as gt
import Rhino as r
import rhinoscriptsyntax as rs

def move_to_origem(obj):
    box = rs.BoundingBox(obj)
    bbox =  r.Geometry.Box(r.Geometry.Plane.WorldZX,box)   
    point = gh.DeconstructBrep(bbox)[2][0]   
    vector = gh.Vector2Pt(point, gh.ConstructPoint(0,0,0), False)
    moved_objs = []
    for i in obj:
        moved_obj,_ = gh.Move(i,vector)
        moved_objs.append(moved_obj)
        print(point)
    return moved_objs
    
a = move_to_origem(A)
b = move_to_origem(B)
c = move_to_origem(C)
d = move_to_origem(D)
# ---------- end ghpython_script ----------

# ----
# Opacity of surfaces
ghpython_script_2 = GhPythonScript(A=ghpython_script.a, B=ghpython_script.b, C=ghpython_script.c, D=ghpython_script.d)  # -> out, opa_A, opa_B, opa_C, opa_D, opa; inputs A: list of Brep, B: list of Brep, C: list of Brep, D: list of Brep
# ---------- ghpython_script_2: Python ----------
__author__ = "joaot"
__version__ = "2022.04.20"

import rhinoscriptsyntax as rs
import ghpythonlib.components as gh
import Rhino.Geometry as rg

def porcentagem(surface):    
    area,_ = gh.Area(surface)     
    area_t,_  =  gh.MassAddition(area)    
    num = round(((area_t/9)*100),2)
    return num


opa_A, opa_B = porcentagem(A),porcentagem(B)
opa_C, opa_D = porcentagem(C),porcentagem(D)
opa = [opa_A, opa_B, opa_C, opa_D]
# ---------- end ghpython_script_2 ----------
panel = Panel(ghpython_script_2.opa_D)
panel_2 = Panel(ghpython_script_2.opa_A)
panel_3 = Panel(ghpython_script_2.opa_B)
panel_4 = Panel(ghpython_script_2.opa_C)

# ----
# Letters of  facades
ghpython_script_3 = GhPythonScript(m=m, n=n, opa=ghpython_script_2.opa, seed=seed, option_sul=option_sul, option_norte=option_norte)  # -> out, area, sul, simplify(norte); inputs m: Int32, n: Int32, opa: list, option_sul: Int32, option_norte: Int32
# ---------- ghpython_script_3: Python ----------
__author__ = "joaot"
__version__ = "2022.04.20"

import rhinoscriptsyntax as rs
import ghpythonlib.components as gh
import ghpythonlib.treehelpers as gt
import Rhino.Geometry as rg
import random as r

n_matriz = n*m
r_letras = []
area_total = 0
norte = []
sul = []
s = 0
n = 0
opa_sul = 30
opa_norte = 60
letras = ["A","B","C","D"]


for x in range(5000):#tentativas
    r_letras = []
    area_total = 0
    #criando uma frase randomicamente
    for i in range(n_matriz):
        a = r.choice(letras)
        r_letras.append(a)
        
    #calculo da area realtivo a frase randon 
    for j in r_letras:
        index = letras.index(j)        
        area_total = area_total + opa[index]
        
    #select facade
    media = area_total/n_matriz    
    if media<opa_sul:
        sul.append(r_letras)
        s=s+1
    elif media> opa_norte:
        norte.append(r_letras)
        n=n+1
        


#norte = gh.TreeBranch(gh.SimplifyTree(gt.list_to_tree(norte),True), option_norte) 
#sul = gh.TreeBranch(gh.SimplifyTree(gt.list_to_tree(sul),True), option_sul) 
print("sul: ",s)
print("norte: ",n)
norte = norte[option_norte if option_norte<n else option_norte-n]
# ---------- end ghpython_script_3 ----------
panel_5 = Panel(ghpython_script_3.norte)

# ----
# vectors
module = Slider(3, range=0..10)
series = Series(Start=0, Step=module, Count=n)
series_2 = Series(Start=0, Step=module, Count=m)
unit_x = UnitX(Factor=series_2)
unit_z = UnitZ(Factor=series)
move = Move(Geometry=graft(unit_x), Motion=unit_z)  # -> flatten(Geometry), Transform

# ----
# matriz
ghpython_script_4 = GhPythonScript(
    seed=seed,
    letters=ghpython_script_3.norte,
    A=ghpython_script.a,
    B=ghpython_script.b,
    C=ghpython_script.c,
    D=ghpython_script.d,
    vec=move.Geometry)  # -> out, phrase, fm; inputs seed: Int32, letters: list, A: Brep, B: Brep, C: Brep, D: Brep, vec: list of Vector3d
# ---------- ghpython_script_4: Python ----------
import rhinoscriptsyntax as rs
import ghpythonlib.components as gh
import ghpythonlib.treehelpers as gt

def order_phrase (seed,letters):
    random_phrase = list(gh.Jitter(letters,1,seed))
    #print(type(random))
    #random_phrase = letters
    return random_phrase[0]
phrase = order_phrase(seed,letters)


print(phrase)
def geometry(A,B,C,D,phrase,vec):
    list_breps = []
    for i in phrase: 
        #print(i)
        if i =="A":
            item = A
        elif i =="B":
            item = B
        elif i =="C":
            item = C
        else:
            item = D
            
        list_breps.append(item)
       
    geo,_ = gh.Move(list_breps,vec)
    
    return geo
fm = geometry(A,B,C,D,phrase,vec)
# ---------- end ghpython_script_4 ----------
panel_6 = Panel(ghpython_script_4.phrase)
panel_7 = Panel(ghpython_script_3.sul)
